# Grasshopper definition 221017_unroll_panel+niche.ghx (Grasshopper 1.0.7)
# plug-ins: Human, Wombat

input = DataInput(
    Destination="/Volumes/GoogleDrive-110500231569640047002/Общие диски/CONTEXTMACHINE/PROJECTS/2202_Lahta_Arc/Lahta Arc_WORK/SF/from_VV/221004_Recess_for_mockup.ghdata",
    RelativePath="/Volumes/GoogleDrive-110500231569640047002/Общие диски/CONTEXTMACHINE/PROJECTS/2202_Lahta_Arc/Lahta Arc_WORK/SF/from_VV/221004_Recess_for_mockup.ghdata|../../../../../../Volumes/GoogleDrive-110500231569640047002/Общие диски/CONTEXTMACHINE/PROJECTS/2202_Lahta_Arc/Lahta Arc_WORK/SF/from_VV/221004_Recess_for_mockup.ghdata",
    UpdateDelay=50000)  # -> Hyp_recess_top, Hyp_recess_Vert_01, Hyp_recess_Vert_02, Hyp_recess_Ribs
input_2 = DataInput(
    Destination="/Volumes/GoogleDrive-110500231569640047002/Общие диски/CONTEXTMACHINE/PROJECTS/2202_Lahta_Arc/Lahta Arc_WORK/MP/gh_data/panel_test_2.ghdata",
    RelativePath="/Volumes/GoogleDrive-110500231569640047002/Общие диски/CONTEXTMACHINE/PROJECTS/2202_Lahta_Arc/Lahta Arc_WORK/MP/gh_data/panel_test_2.ghdata|../../../../../../Volumes/GoogleDrive-110500231569640047002/Общие диски/CONTEXTMACHINE/PROJECTS/2202_Lahta_Arc/Lahta Arc_WORK/MP/gh_data/panel_test_2.ghdata",
    UpdateDelay=50000)  # -> Hyp_panels_surf_3, Hyp_panels_surf_6
trim = TrimTree(Tree=input.Hyp_recess_Ribs, Depth=1)
tstat = TreeStatistics(Tree=trim)  # -> Paths, Length, Count
srf = Surface(flatten(input.Hyp_recess_Vert_01))
srf_2 = Surface(flatten(input.Hyp_recess_Vert_02))
srf_3 = Surface(flatten(input.Hyp_recess_top))
panel = Panel("""301
302
303""")
number_slider = Slider(50, range=0..100)
item = ListItem(List=tstat.Paths, Index=panel, Wrap=True)
srf_4 = Surface(input_2.Hyp_panels_surf_6)
item_2 = ListItem(List=srf, Index=panel, Wrap=True)
branch = TreeBranch(Tree=trim, Path=item, MaintainPaths=True)
item_3 = ListItem(List=srf_3, Index=panel, Wrap=True)
item_4 = ListItem(List=srf_2, Index=panel, Wrap=True)
flip = Flip(Surface=srf_4)  # -> Surface, Result
extendsrf = ExtendSurface(Surface=branch, WestEdge=0, SouthEdge=number_slider, EastEdge=0, NorthEdge=number_slider, ExtensionType=True)
number_slider_2 = Slider(1, range=0..10)
bang = ExplodeTree(Data=branch)  # -> Branch0, Branch1
flip_2 = Flip(Surface=item_4)  # -> Surface, Result
flip_3 = Flip(Surface=item_2)  # -> Surface, Result
panel_2 = Panel(item_3)
item_5 = ListItem(List=flip.Surface, Index=0, Wrap=True)  # -> flatten(Item), flatten(Item1)
flip_4 = Flip(Surface=item_3)  # -> Surface, Result
panel_3 = Panel("""0
1
0
1
0
1""")
item_6 = ListItem(List=flip_4.Surface, Index=0, Wrap=True)
item_7 = ListItem(List=flip_3.Surface, Index=0, Wrap=True)
file = ReadFile(File="/Users/sofyadobycina/Documents/GitHub/mmodel/panels_gh/main.py", PerLineParse=False)
item_8 = ListItem(List=flip_2.Surface, Index=0, Wrap=True)
srf_5 = Surface(flatten(flip.Surface))

# ---- group: left_rebra
bbx = BrepBrep(BrepA=graft(flip_2.Surface), BrepB=extendsrf)  # -> Curves, Points
trim_2 = TrimTree(Tree=bbx.Curves, Depth=1)
unroll_brep = UnrollBrep(Brep=graft(flip_2.Surface), Curves=trim_2)  # -> flatten(Brep), Curves, Points

# ---- group: right_rebra
bbx_2 = BrepBrep(BrepA=graft(flip_3.Surface), BrepB=extendsrf)  # -> Curves, Points
trim_3 = TrimTree(Tree=bbx_2.Curves, Depth=1)
unroll_brep_2 = UnrollBrep(Brep=graft(flip_3.Surface), Curves=trim_3)  # -> flatten(Brep), Curves, Points

# ----
rotate = Rotate(Geometry=item_5.Item1, Angle=degrees(Slider(180, range=0..1000)), Plane=PlaneXY(0, 0, 0))  # -> Geometry, Transform
panel_4 = Panel(item_6)
file_2 = ReadFile(File="/Users/sofyadobycina/Documents/GitHub/mmodel/panels_gh/main_niche_unroll.py", PerLineParse=False)
item_9 = ListItem(List=flip_3.Surface, Index=0, Wrap=True)
python = GhPythonScript(Code=file, Panels=srf_5, Tip=panel_3)  # -> Out, Fres, Cut, Panel
python_2 = GhPythonScript(Code=file_2, Panels_right=item_7, Panels_left=item_8, Rebra=bang.Branch0, Back_side=item_6)  # -> Out, Cut, Fres, A, B
python_3 = GhPythonScript()  # -> out, a
# ---------- python_3: Python ----------
__author__ = "sofyadobycina"

import rhinoscriptsyntax as rs
rs.CurveStartPoint
# ---------- end python_3 ----------
number_slider_3 = Slider(0, range=0..10)
flip_5 = FlipMatrix(Data=python_2.Cut)
flip_6 = FlipMatrix(Data=python_2.Fres)
flip_7 = FlipMatrix(Data=python.Fres)
flip_8 = FlipMatrix(Data=python.Cut)
number_slider_4 = Slider(0, range=0..10)
crv = Curve(python_2.B)
crv_2 = Curve(python_2.A)
number_slider_5 = Slider(2, range=0..10)
len = Length(Curve=unroll_brep_2.Curves)
item_10 = ListItem(List=flip_6, Index=number_slider_3, Wrap=True)
item_11 = ListItem(List=flip_5, Index=number_slider_3, Wrap=True)
item_12 = ListItem(Index=Slider(7, range=0..10), Wrap=True)
item_13 = ListItem(List=flip_7, Index=number_slider_4, Wrap=True)
item_14 = ListItem(List=flip_8, Index=number_slider_4, Wrap=True)
panel_5 = Panel(python_2.A)
item_15 = ListItem(List=python.Panel, Index=0, Wrap=True)
item_16 = ListItem(List=unroll_brep_2.Brep, Index=0, Wrap=True)  # -> graft(Item)
offsets = OffsetOnSrf(Distance=1, Surface=item_16)
previewlw = CustomPreviewLineweights(Geometry=item_11, Shader=ColourSwatch(SwatchColor=RGB(255, 254, 254)), Thickness=number_slider_5, Absolute=False)
previewlw_2 = CustomPreviewLineweights(Geometry=item_10, Shader=ColourSwatch(SwatchColor=RGB(255, 0, 0)), Thickness=number_slider_5, Absolute=False)
panel_6 = Panel(len)
previewlw_3 = CustomPreviewLineweights(Geometry=item_14, Shader=ColourSwatch(SwatchColor=RGB(178, 255, 0)), Thickness=Slider(2, range=0..10), Absolute=False)
previewlw_4 = CustomPreviewLineweights(Geometry=item_13, Shader=ColourSwatch(SwatchColor=RGB(255, 0, 0)), Thickness=Slider(2, range=0..10), Absolute=False)
number_slider_6 = Slider(45, range=0..100)
number_slider_7 = Slider(45, range=0..100)
python_4 = GhPythonScript(panel=item_15, niche=number_slider_7, bottom=number_slider_7, top=Slider(35, range=0..100))  # -> out, a, flatten(frame)
# ---------- python_4: Python ----------
__author__ = "sofyadobycina"

import rhinoscriptsyntax as rs
import Rhino.Geometry as rh
import math

def offset(crv, ofs_dist, extend=None):
    c = rh.Curve.Offset(crv, rh.Plane.WorldXY, ofs_dist, 0.01, rh.CurveOffsetCornerStyle.Sharp)[0]
    if extend is not None:
        c = rh.Curve.Extend(c, rh.Interval(extend[0], extend[1]))
    return c
    
def bound_rec(crv):
    join = rh.Curve.JoinCurves(crv)[0]
    bound_rec = rh.PolyCurve.GetBoundingBox(join, rh.Plane.WorldXY)
    return bound_rec
    
def intersect(values):
    res = []
    for i, v in enumerate(values):
        param = []
        for ind, val in enumerate(values):
            if i != ind:
                inters = rs.CurveCurveIntersection(v, val)
                if inters is not None:
                    param.append(inters[0][5])
        param = sorted(param)
        if len(param) != 1 and i!=0:
            trimed = rh.Curve.Trim(v, param[0], param[1])
        elif i==3:
            trimed = rh.Curve.Trim(v, v.Domain[0], param[0])
        elif i==0 and len(param) != 1:
            trimed = rh.Curve.Trim(v, param[1], v.Domain[1])
        else:
            trimed = rh.Curve.Trim(v, param[0], v.Domain[1])
        res.append(trimed)
    return res


class FramePanel:
    niche = 45
    bottom = 45
    top = 35
    diag = 20
    
    bottom_rec = 30
    side_rec = 30
    
    
    @property
    def frame_offset(self):
        self._frame_offset = rh.Curve.JoinCurves(self.all_offset()[0:3])
        return self._frame_offset
    
    @property
    def p_top(self):
        self._p_top= self.all_offset()[3]
        return self._p_top
    
    @property
    def frame_all(self):
        self._frame_all = rh.Curve.JoinCurves(self.all_offset())
        return self._frame_all
    
    @property
    def bound_frame(self):
        rec = bound_rec(self.frame_all)
        min_transl = rh.Point3d(rec.Min[0] - FramePanel.side_rec, rec.Min[1] - FramePanel.bottom_rec, 0)
        self._bound_frame = rh.Rectangle3d(rh.Plane.WorldXY, min_transl, rec.Max)
        return self._bound_frame
        
    def __init__(self, panel):
        self.panel = panel
        self.p_niche = self.panel.fres[1]
        self.p_bottom = self.panel.fres[0]
        
    def all_offset(self):
        niche = offset(self.p_niche, FramePanel.niche, extend=[self.p_niche.Domain[0]+200, self.p_niche.Domain[1]-200])

        if niche is None:
            niche = offset(self.p_niche, FramePanel.niche, extend=[self.p_niche.Domain[0]-200, self.p_niche.Domain[1]+200])

        bottom = offset(self.p_bottom, FramePanel.bottom, extend=[self.p_bottom.Domain[0]-200, self.p_bottom.Domain[1]])
        top_s = self.top_side()
        top = offset(self.top_side(), FramePanel.top, extend=[top_s.Domain[0], top_s.Domain[1]+200])
        diag = offset(self.diag_side(), FramePanel.diag)

        all_offset = [bottom, diag, niche, top]
        
        all_offset = intersect(all_offset)
        return all_offset

        
    def top_side(self):
        bound = bound_rec(self.panel.fres)
        top_side = bound.GetEdges()[2]
        return top_side.ToNurbsCurve()
        
    def diag_side(self):
        st = self.panel.niche.top_part.PointAtEnd
        en = self.panel.side[0].top_part.PointAtStart
        p = self.panel.niche.fres.PointAtEnd
        
        crv = rh.Line.ToNurbsCurve(rh.Line(st, en))
        
        crv_d = crv.PointAtLength(rh.Curve.DivideByCount(crv, 2, False)[0])
        FramePanel.diag = rh.Point3d.DistanceTo(p, crv_d) + 10
        return crv


    
FramePanel.niche = niche
FramePanel.bottom = bottom
FramePanel.top = top
aa = FramePanel(panel)

#a = aa.all_offset()
a = aa.bound_frame
frame = aa.frame_offset
# ---------- end python_4 ----------
python_5 = GhPythonScript(panel=item_15, niche=number_slider_6, bottom=number_slider_6, top=Slider(35, range=0..100))  # -> out, a, flatten(frame); same code as python_4
panel_7 = Panel(python_4.frame)
item_17 = ListItem(List=python_4.a, Index=0, Wrap=True)  # -> flatten(Item)
item_18 = ListItem(List=python_4.frame, Index=0, Wrap=True)  # -> flatten(Item)
previewlw_5 = CustomPreviewLineweights(Geometry=item_17, Shader=ColourSwatch(SwatchColor=RGB(0, 81, 255)), Thickness=Slider(4, range=0..10), Absolute=False)
previewlw_6 = CustomPreviewLineweights(Geometry=item_18, Shader=ColourSwatch(SwatchColor=RGB(0, 191, 255)), Thickness=Slider(3, range=0..10), Absolute=False)
